# Grasshopper definition 8.2moving worm.gh (Grasshopper 1.0.7)

panel = Panel("""0
1
-1
1""")
panel_2 = Panel("""0
1
-2
1""")
# click to reset
button = Button()
trigger = Trigger(Interval=50, TimerInterval=50, Target=ghpython_script)  # disabled
panel_3 = Panel("""0
3
-3
3""")
panel_4 = Panel("""0
1
-1
1""")
trigger_2 = Trigger(Interval=50, TimerInterval=50, Target=ghpython_script_2)  # disabled
# www.Rhino3d.education©
# GhPython   Dive Deeper
# 
# Instructor |  Niloofar Zaker
# 
# Zaker_niloofar@yahoo.com
ghpython_script = GhPythonScript(n=panel, n1=panel_2, reset=button)  # -> out, a; inputs n: list, n1: list, reset: Boolean
# ---------- ghpython_script: Python ----------
import Rhino.Geometry as rg
import random as rn

if "pt" not in globals() or reset :
    pt = rg.Point2d(0,0)
    pts= [pt] *20
pt  += rg.Vector2d(rn.choice(n) , rn.choice(n1))
pts.append(pt)

a = pts
# ---------- end ghpython_script ----------
ghpython_script_2 = GhPythonScript(n=panel_4, n1=panel_3, reset=Button())  # -> out, a; inputs n: list, n1: list
# ---------- ghpython_script_2: Python ----------
import Rhino.Geometry as rg
import random as rn

if "pt" not in globals() or reset :
        pt = rg.Point2d(0,0)
        pts= [pt] * 20
pt += rg.Vector2d(rn.choice(n) , rn.choice(n1))
pts.append(pt)
a= pts
        
#a +=b # a = a+b
# ---------- end ghpython_script_2 ----------
nurbs_curve = NurbsCurve(Vertices=ghpython_script.a, Degree=3, Periodic=False)  # -> Curve, Length, Domain
polyline = PolyLine(Vertices=ghpython_script.a, Closed=False)
nurbs_curve_2 = NurbsCurve(Vertices=ghpython_script_2.a, Degree=3, Periodic=False)  # -> Curve, Length, Domain
panel_5 = Panel(ghpython_script_2.a)
pipe = Pipe(Curve=polyline, Radius=Slider(0.1, range=0..0.1), Caps=0)
polyline_2 = PolyLine(Vertices=ghpython_script_2.a, Closed=False)
pipe_2 = Pipe(Curve=polyline_2, Radius=Slider(0.1, range=0..0.1), Caps=0)
