# Grasshopper definition attractor tree.gh (Grasshopper 1.0.7)
# plug-ins: Rhino.Inside for Autodesk Revit

graphical_element = GraphicalElement(<familyinstance referenced from the Revit model>)
element_location = ElementLocation(Element=graphical_element)  # -> Element, Location, Hand, Facing, WorkPlane
custom_preview = CustomPreview(Geometry=graphical_element, Material=ColourSwatch(SwatchColor=RGB(0, 94, 24)))
deconstruct = Deconstruct(Point=element_location.Location)  # -> XComponent, YComponent, ZComponent
construct_point = ConstructPoint(XCoordinate=deconstruct.XComponent, YCoordinate=deconstruct.YComponent, ZCoordinate=0)
surface = Surface(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)
_6_7_1 = GhPythonScript(
    srf=surface,
    pt=construct_point,
    n=Slider(35, range=0..100),
    x=Slider(0.32, range=0..1),
    y=Slider(16, range=0..100),
    split_num=Slider(140, range=0..1000))  # -> out, sub_sef, distances, centers, c, d, shuffled_cells; inputs srf: Surface, pt: Point3d, n: Int32, y: Int32, split_num: Int32
# ---------- _6_7_1: Python ----------
import ghpythonlib.components as gh
import rhinoscriptsyntax as rs

#create cells
domain = gh.DivideDomain2(srf,n,n)
sub_srf = gh.Isotrim(srf,domain)

#get distances
centers = gh.Area(sub_srf)[1]
distances = []
for i in centers:
    distances.append(gh.Distance(i, pt))


#sort distances
b = distances[:]
b.sort()

#orgonize(sorting) cells based on the distances

c=[]

for i in b :
    c.append(sub_srf[distances.index(i)])

d = gh.Jitter(c , x , y)[0]

shuffled_cells = d[:split_num]

f=[]
for i in range(len(sub_srf)):
    if sub_srf[i] in shuffled_cells:
        remove(sub_srf[i])
    else:
        f.append(sub_srf[i])
# ---------- end _6_7_1 ----------
custom_preview_2 = CustomPreview(Geometry=surface, Material=ColourSwatch(SwatchColor=RGB(141, 204, 157)))
directshape_categories = DirectShapeCategories({"Abutments": -2006130, "Air Terminals": -2008013, "Bearings": -2006138, "Bridge Cables": -2006133, "Bridge Decks": -2006135, "Bridge Framing": -2006241, "Cable Tray Fittings": -2008126, "Cable Tray Runs": -2008150, "Cable Trays": -2008130, "Casework": -2001000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}, selected="Floors": -2000032)
surface_2 = Surface(_6_7_1.shuffled_cells)
surface_3 = Surface(surface)
unit_z = UnitZ(Factor=Slider(631, range=0..1000))
directshape_categories_2 = DirectShapeCategories({"Abutments": -2006130, "Air Terminals": -2008013, "Bearings": -2006138, "Bridge Cables": -2006133, "Bridge Decks": -2006135, "Bridge Framing": -2006241, "Cable Tray Fittings": -2008126, "Cable Tray Runs": -2008150, "Cable Trays": -2008130, "Casework": -2001000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}, selected="Floors": -2000032)
add_geometry_directshape = AddGeometryDirectShape(Name="field", Category=directshape_categories, Geometry=surface_3)
extrude = Extrude(Base=surface_2, Direction=unit_z)
custom_preview_3 = CustomPreview(Geometry=extrude, Material=ColourSwatch(SwatchColor=RGB(42, 117, 105)))
add_geometry_directshape_2 = AddGeometryDirectShape(Name="nearest", Category=directshape_categories_2, Geometry=extrude)
